# Grasshopper definition front_end.gh (Grasshopper 1.0.7)
# plug-ins: MeshEdit Components

radopaquemat = HoneybeePlus_RadianceOpaqueMaterial(name="Context_mat", reflect="0.2", spec=0, rough=0)  # -> material; plug-in component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
context = Brep([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])
hbsurface = HoneybeePlus_HoneybeeSurface(geo=context, names="Context", rad_mat=radopaquemat)  # -> report, HB_srf; plug-in component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

# ---- group: Ext. walls only
brep = Brep([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])

# ---- group: Rest of Volume massing
zone = Brep([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])

# ----
radpargridbased = HoneybeePlus_RadianceParametersGridBased(complexity=Slider(0, range=0..2), recipe_type="1")  # -> report, rad_par, vmtx_par, dmtx_par, smtx_par; plug-in component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
d_matrix = Panel(radpargridbased.dmtx_par)

area = Area(Geometry=brep)  # -> Area, Centroid
genpts = LBGeneratePointGrid(geometry=brep, grid_size="4", offset_dist="0.05")  # -> points, vectors, face_areas, graft(mesh); plug-in component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
panel_2 = Panel(area.Area)
facen = FaceNormals(Mesh=genpts.mesh)  # -> Centers, Normals
analysisgrid = HoneybeePlus_AnalysisGrid(name="facade_points_88", test_points=genpts.points, pts_vectors=genpts.vectors)  # -> analysis_grid; plug-in component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
vdis = VectorDisplay(Anchor=facen.Centers, Vector=facen.Normals)

radpargridbased_2 = HoneybeePlus_RadianceParametersGridBased(complexity=Slider(0, range=0..2), recipe_type="1")  # -> report, rad_par, vmtx_par, dmtx_par, smtx_par; plug-in component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
v_matrix = Panel(radpargridbased_2.vmtx_par)
d_matrix_2 = Panel(radpargridbased_2.dmtx_par)

hbsurface_2 = HoneybeePlus_HoneybeeSurface(geo=zone)  # -> report, HB_srf; plug-in component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
hbsurface_3 = HoneybeePlus_HoneybeeSurface(geo=brep)  # -> report, HB_srf; plug-in component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

wires = BrepWireframe(Brep=[zone, brep], Density=-1)
preview = CustomPreview(Geometry=[zone, brep], Material=ColourSwatch(SwatchColor=RGB(255, 0, 0)))

panel_3 = Panel("C:\baseline_test_new\input")

wires_2 = BrepWireframe(Brep=context, Density=-1)
preview_2 = CustomPreview(Geometry=context, Material=ColourSwatch(SwatchColor=RGB(150, 150, 150)))

panel_4 = Panel("C:\Users\Pedersen_Admin\OneDrive - Perkins and Will\Desktop\baseline_test\simulation_files\sky\NOR_Oslo.Fornebu.014880_IWEC.epw")
wea = HoneybeePlus_WEAFromEPW(epw_file=panel_4)  # -> wea; plug-in component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
skymatrix = HoneybeePlus_SkyMatrix(name="SkyMatrix_88", north=0, wea=wea, density=1)  # -> skymtx; plug-in component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

mesh = Mesh(genpts.mesh)
explode = MeshExplode(Mesh=mesh, Interpolate=False)
# Honeybee Simulation
panel_5 = Panel(explode)

# ---- group: Export rest of volume massing to rad
panel_6 = Panel("volume_massing_rest.rad")
hbtorad = HoneybeePlus_WriteHBObjectsToRadiance(HB_objects=hbsurface_2.HB_srf, folder=panel_3, file_name=panel_6, write=Toggle(False))  # -> rad_file; plug-in component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
concat = Concatenate(FragmentA=panel_3, FragmentB="\", FragmentC=panel_6)
importrad = Honeybee_ImportRad(radianceFile=concat)  # -> RADMaterials, RADSurfaces; plug-in component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

# ---- group: Export volume massing to rad
# VMT tool input
panel_7 = Panel("volume_massing.rad")
hbtorad_2 = HoneybeePlus_WriteHBObjectsToRadiance(HB_objects=hbsurface_3.HB_srf, folder=panel_3, file_name=panel_7, write=Toggle(False))  # -> rad_file; plug-in component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
concat_2 = Concatenate(FragmentA=panel_3, FragmentB="\", FragmentC=panel_7)
importrad_2 = Honeybee_ImportRad(radianceFile=concat_2)  # -> RADMaterials, RADSurfaces; plug-in component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

# ---- group: Export context to rad
hbtorad_3 = HoneybeePlus_WriteHBObjectsToRadiance(HB_objects=hbsurface.HB_srf, folder=panel_3, file_name="context.rad", write=Toggle(False))  # -> rad_file; plug-in component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
concat_3 = Concatenate(FragmentA=panel_3, FragmentB="\", FragmentC="context.rad")
importrad_3 = Honeybee_ImportRad(radianceFile=concat_3)  # -> RADMaterials, RADSurfaces; plug-in component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

# ----
flatten = FlattenTree(Tree=analysisgrid, Path="{0}")

annualradrecipe = HoneybeePlus_AnnualRadiationRecipe(skymtx=skymatrix, analysis_grids=flatten, dmtx_par=radpargridbased_2.dmtx_par, reuse_dmtx="True")  # -> analysis_recipe; plug-in component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

panel_8 = Panel("C:\Users\Pedersen_Admin\OneDrive - Perkins and Will\Desktop\baseline_test")
data = Data([hbsurface_2.HB_srf, hbsurface.HB_srf])
runradiance = HoneybeePlus_RunRadianceAnalysis(
    analysis_recipe=annualradrecipe,
    HB_objects=data,
    folder=panel_8,
    name="HBplus_RADIATION",
    write=Toggle(False),
    run=Toggle(False))  # -> report, legend_par, outputs; plug-in component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

panel_9 = Panel("""C:\Users\Pedersen_Admin\OneDrive - Perkins and Will\Desktop\baseline_test\simulation_files\radiation_grid\mesh_0.txt
C:\Users\Pedersen_Admin\OneDrive - Perkins and Will\Desktop\baseline_test\simulation_files\radiation_grid\mesh_1.txt
C:\Users\Pedersen_Admin\OneDrive - Perkins and Will\Desktop\baseline_test\simulation_files\radiation_grid\mesh_2.txt
C:\Users\Pedersen_Admin\OneDrive - Perkins and Will\Desktop\baseline_test\simulation_files\radiation_grid\mesh_3.txt""")
python = GhPythonScript(mesh_files=panel_9, run=Toggle(False))  # -> out, M
# ---------- python: Python ----------
__author__ = "Pedersen_Admin"
__version__ = "2021.02.10"

import rhinoscriptsyntax as rs
import os 

if run:
    V = []
    F = []
    with open(mesh_files, "r") as infile:
        content = infile.readlines()
    
    read_vertices = False
    read_fases = False
    for j in range(len(content)):
        
        if "### Mesh vertices" in content[j]:
            read_vertices = True
            read_fases = False
            continue
            
        elif "### Mesh faces" in content[j]:
            read_vertices = False
            read_fases = True
            continue
        
        if read_vertices:
            numbers = content[j].split(" ")
            V.append((float(numbers[0]),
            float(numbers[1]),
            float(numbers[2])))
            
        elif read_fases:
            numbers = content[j].split(" ")
            F.append((int(numbers[0]),
            int(numbers[1]),
            int(numbers[2]),
            int(numbers[3])))
    
    M = rs.AddMesh(V,F) #https://discourse.mcneel.com/t/creating-meshes-from-scratch/22504/2
# ---------- end python ----------
mesh_2 = Mesh(python.M)
explode_2 = MeshExplode(Mesh=mesh_2, Interpolate=False)

panel_10 = Panel("C:\Users\Pedersen_Admin\OneDrive - Perkins and Will\Desktop\baseline_test\simulation_files\radiation_grid\surf_all.pts")
python_2 = GhPythonScript(all_points_file=panel_10, run=Toggle(False))  # -> out, P, N
# ---------- python_2: Python ----------
__author__ = "Pedersen_Admin"
__version__ = "2021.02.10"

import rhinoscriptsyntax as rs
import os 

if run:
    P = []
    N = []
    with open(all_points_file, "r") as infile:
        content = infile.readlines()
        
    for i in range(len(content)):
        try:
            numbers = content[i].split(" ")
            print(numbers)
            P.append(rs.AddPoint(float(numbers[0]),float(numbers[1]),float(numbers[2])))
            
            N.append(rs.AddPoint(float(numbers[3]),float(numbers[4]),float(numbers[5])))
            
        except: #Last line
            pass
# ---------- end python_2 ----------
vdis_2 = VectorDisplay(Anchor=python_2.P, Vector=python_2.N)

panel_11 = Panel(genpts.mesh)
cumvalue = HoneybeePlus_CumulativeValue(analysis_grid=runradiance.outputs)  # -> report, values; plug-in component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
panel_12 = Panel(cumvalue.values)
flatten_2 = FlattenTree(Tree=cumvalue.values, Path="{0}")
sort = SortList(Keys=flatten_2)  # -> Keys, ValuesA
panel_13 = Panel(mesh_2)
item = ListItem(List=sort.Keys, Index="-1", Wrap=True)
item_2 = ListItem(List=sort.Keys, Index="0", Wrap=True)
panel_14 = Panel(sort.Keys)
heatmap = LBSpatialHeatmap()  # -> mesh, legend, title, colors, legend_par; plug-in component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
panel_15 = Panel(item_2)
panel_16 = Panel(item)
legendpar = LBLegendParameters(min=item_2, max=item)  # -> leg_par; plug-in component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
heatmap_2 = LBSpatialHeatmap(values=cumvalue.values, mesh=genpts.mesh, legend_par=legendpar)  # -> mesh, legend, title, colors, legend_par; plug-in component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
